# Grasshopper definition test.gh (Grasshopper 1.0.8)
# Copyright: Arup

# Sveiks. Šis ir test
py3 = Python3Script()  # -> out, a
# ---------- py3: Python ----------
"""Grasshopper Script"""
a = "Hello Python 3 in Grasshopper!"
print("KOPAA")
# ---------- end py3 ----------
panel = Panel(py3.a)
pt = ConstructPoint(XCoordinate=Slider(104, range=0..1000), YCoordinate=Slider(148, range=0..1000), ZCoordinate=Slider(108, range=0..1000))
