# Grasshopper definition test_gypython - Copy.gh (Grasshopper 1.0.8)
# Copyright: Arup

python = GhPythonScript()  # -> out, a
# ---------- python: Python ----------
__author__ = "raiti"
__version__ = "2025.04.02"

import rhinoscriptsyntax as rs
print ("hello kopaa")
# ---------- end python ----------
pt = ConstructPoint(XCoordinate=Slider(0, range=0..1000), YCoordinate=Slider(0, range=0..1000), ZCoordinate=Slider(0, range=0..1000))
pt_2 = ConstructPoint(XCoordinate=Slider(104, range=0..1000), YCoordinate=Slider(148, range=0..1000), ZCoordinate=Slider(108, range=0..1000))
ln = Line(StartPoint=pt, EndPoint=pt_2)
