# Grasshopper definition test_gypython.gh (Grasshopper 1.0.7)
# Copyright: Arup

python = GhPythonScript()  # -> out, a
# ---------- python: Python ----------
__author__ = "raiti"
__version__ = "2025.04.02"

import rhinoscriptsyntax as rs
print ("hello kopaa")
print ("pievienoju šo tekstu otrajā gājienā")
# ---------- end python ----------
